# Grasshopper definition batterfly.gh (Grasshopper 1.0.7)

velocity_m_s = Slider(6, range=0..10)
inlet = Geometry(<brep referenced from the Rhino model>)
amplitude = Amplitude(Vector=inlet, Amplitude=velocity_m_s)
temperature_c = Panel("20")
wall = Butterfly_WallBoundary(temperature=temperature_c)  # -> wall_boundary; plug-in component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
outlet = Butterfly_OutletBoundary(temperature=temperature_c)  # -> outlet_boundary; plug-in component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
refine_levels = Panel("4,4")
inletvel = Butterfly_InletBoundary(velocity_vec=amplitude, temperature=temperature_c)  # -> inlet_boundary; plug-in component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
settings_quality = SettingsQuality()
wall_2 = Geometry(<brep referenced from the Rhino model>)
outlet_2 = Geometry(<brep referenced from the Rhino model>)
createbfgeometry = Butterfly_CreateButterflyGeometry(name="wall", geo=flatten(wall_2), boundary=wall, refine_levels=refine_levels, mesh_set=settings_quality)  # -> out, BF_geo; plug-in component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
createbfgeometry_2 = Butterfly_CreateButterflyGeometry(name="inlet", geo=flatten(inlet), boundary=inletvel, refine_levels=refine_levels, mesh_set=settings_quality)  # -> out, BF_geo; plug-in component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
brep_wireframe = BrepWireframe(Brep=wall_2, Density=-1)
createbfgeometry_3 = Butterfly_CreateButterflyGeometry(name="outlet", geo=flatten(outlet_2), boundary=outlet, refine_levels=refine_levels, mesh_set=settings_quality)  # -> out, BF_geo; plug-in component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
merge = Merge(Data1=createbfgeometry.BF_geo, Data2=createbfgeometry_2.BF_geo, Data3=createbfgeometry_3.BF_geo)
casefromgeos = Butterfly_CreateCaseFromGeometries(name="sim3", BF_geo=flatten(merge), expand_block_mesh=True, run=Toggle(True))  # -> out, block_pts, case; plug-in component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
ras = Butterfly_RASTurbulenceModel(RAS_model="RNGkEpsilon", turbulence=True, print_coeffs=True)  # -> RAS; plug-in component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
les = Butterfly_LESTurbulenceModel(LES_model="kEqn", delta="cubeRootVol", turbulence=True, print_coeffs=True)  # -> LES; plug-in component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
boolean_toggle = BooleanToggle(True)
panel = Panel("300")
point = Point(<point referenced from the Rhino model>)
blockmesh = Butterfly_blockMesh(case=casefromgeos.case, overwrite=True, write=boolean_toggle, run=boolean_toggle)  # -> out, case; plug-in component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
controldict = Butterfly_controlDict(start_time=0, end_time=1000, write_interval=100, write_compression=False, purge_write=0)  # -> control_dict; plug-in component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
snappyhexmesh = Butterfly_snappyHexMesh(case=blockmesh.case, location_in_mesh=point, write=Toggle(True), run=Toggle(True))  # -> out, case; plug-in component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
steadyincomp = Butterfly_SteadyIncompressibleRecipe(turbulence_prop=ras)  # -> out, recipe; plug-in component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
boolean_toggle_2 = BooleanToggle(True)
loadpoints = Butterfly_LoadPoints(case=snappyhexmesh.case, load=boolean_toggle_2)  # -> pts; plug-in component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
boolean_toggle_3 = BooleanToggle(False)
loadmesh = Butterfly_LoadMesh(case=snappyhexmesh.case, inner_mesh=boolean_toggle_2, load=Toggle(True))  # -> mesh; plug-in component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
brep = Brep(<brep referenced from the Rhino model>)
brep_2 = Brep(<brep referenced from the Rhino model>)
point_in_brep = PointInBrep(Brep=brep, Point=loadpoints, Strict=boolean_toggle_3)
point_in_brep_2 = PointInBrep(Brep=brep_2, Point=loadpoints, Strict=boolean_toggle_3)
cull_pattern = CullPattern(List=loadpoints, CullPattern=point_in_brep)
cull_pattern_2 = CullPattern(List=loadpoints, CullPattern=point_in_brep_2)
point_2 = Point([cull_pattern_2, cull_pattern])
probes = Butterfly_probes(points=point_2)  # -> probes; plug-in component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
solutionparams = Butterfly_SolutionParameters(control_dict=controldict, probes=probes)  # -> solution_par; plug-in component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
solution = Butterfly_Solution(
    case=snappyhexmesh.case,
    recipe=steadyincomp.recipe,
    solution_par=solutionparams,
    interval=2,
    write=Toggle(True),
    run=Toggle(True))  # -> out, solution, is_running, timestep, residual_fields, residual_values, log_files; plug-in component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
list_length = ListLength(List=point_2)
division = Division(A=list_length, B=2)
loadprobesvalue = Butterfly_LoadProbesValue(solution=solution.solution, field="p")  # -> values; plug-in component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
loadprobesvalue_2 = Butterfly_LoadProbesValue(solution=solution.solution, field="U")  # -> values; plug-in component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
split_list = SplitList(List=loadprobesvalue, Index=division)  # -> ListA, ListB
amplitude_2 = Amplitude(Vector=loadprobesvalue_2, Amplitude="0.01")
panel_2 = Panel(solution.out)
average = Average(Input=split_list.ListB)
average_2 = Average(Input=split_list.ListA)
vector_display_ex = VectorDisplayEx(Point=point_2, Vector=amplitude_2, Colour=RGB(0, 0, 0), Width=2)
panel_3 = Panel(average_2)
panel_4 = Panel(average)
subtraction = Subtraction(A=panel_4, B=panel_3)
panel_5 = Panel(subtraction)
# Venture Industries: Łuk o przekroju okrągłym
# R/D = 1.00
# kąt = 90*
# dzeta = 0,22
ghpython_script = GhPythonScript(dp=panel_5, v=velocity_m_s)  # -> out, dzeta
# ---------- ghpython_script: Python ----------
__author__ = "thinkpad"
__version__ = "2024.03.27"

rho = 1.205
dzeta = 2*dp / (rho * v**2)
dzeta = round(dzeta, 2)
# ---------- end ghpython_script ----------
panel_6 = Panel(ghpython_script.dzeta)
